# Grasshopper definition test.gh (Grasshopper 1.0.7)
# plug-ins: Volvox, Kangaroo2 Components, Pancake, Pufferfish, Tarsier

subsampling_by_taking_each_10th_point = Slider(10, range=0..20)
which_part_of_the_sliced_surface = Slider(2, range=0..10)
which_part_of_the_sliced_object = Slider(0, range=0..10)
upscaling_factor_about_2 = Slider(3, range=0..10)
face_count_about_200 = Slider(250, range=0..1000)
_2d_boundary_curve = Curve(<curve referenced from the Rhino model>)
accuracy_about_10 = Slider(10, range=0..10)
z_vector_for_extrusion_length = Panel("{0,0,-200}")
point_cloud = Cloud(<cloud referenced from the Rhino model>)
designed_geometry = Brep(<brep referenced from the Rhino model>)
mesh = Mesh(designed_geometry)
msh2psrf = MeshToPolysurface(Mesh=mesh, Triangles=False, FaceMerge=False)

# ---- group: Region of interest
srf = Surface(_2d_boundary_curve)
extr = Extrude(Base=srf, Direction=z_vector_for_extrusion_length)
volume = Volume(Geometry=extr)  # -> Volume, Centroid
scale = Scale(Geometry=extr, Center=volume.Centroid, Factor=upscaling_factor_about_2)  # -> Geometry, Transform

# ---- group: Reduced point Cloud
vsub = VoxelSubsampling(Size=subsampling_by_taking_each_10th_point)
cloude = CloudEngine(Cloud=point_cloud, Instruction0=vsub)
decloud = DeconstructCloud(Cloud=cloude)  # -> Points, Normals, Colors
pt = Point(decloud.Points)
brepinc = PointInBrep(Brep=scale.Geometry, Point=pt, Strict=False)
dispatch = Dispatch(List=pt, DispatchPattern=brepinc)  # -> ListA, ListB
pt_2 = Point(dispatch.ListA)

# ---- group: Rebuilding the Delauny Triangulation with adjusted parameters
del = DelaunayMesh(Points=pt_2, Plane=PlaneXY(0, 0, 0))
clean = CombineClean(Meshes=del)
weld = WeldMesh(Mesh=clean, Angle=3.141592654)
redumsh = ReduceMesh(Mesh=weld, FaceCount=face_count_about_200, Accuracy=accuracy_about_10, FaceType=1, Distort="TRUE", Normalize=False)  # -> Reduced, CountDifference

# ---- group: Slice the surface with the designed object
mesh_2 = Mesh(redumsh.Reduced)
msh2psrf_2 = MeshToPolysurface(Mesh=mesh_2, Triangles=False, FaceMerge=False)
splitmul = SplitBrepMultiple(Brep=msh2psrf_2, Cutters=msh2psrf)
item = ListItem(List=splitmul, Index=which_part_of_the_sliced_surface, Wrap=True)

# ---- group: To be printed object
print_object = MeshBrep(
    Brep=designed_geometry,
    Settings={GridMaxCount=0, GridMinCount=16, JaggedSeams=False, MaxEdgeLength=0, MinEdgeLength=0.0001, MinTolerance=0, Refine=True, RefineAngle=0, RelativeTolerance=0.65, SimplePlanes=True, Tolerance=0})

# ---- group: Split designed Object with surface
msplit = MeshSplit(Mesh=print_object, Splitters=redumsh.Reduced)
item_2 = ListItem(List=msplit, Index=which_part_of_the_sliced_object, Wrap=True)
clean_2 = CombineClean(Meshes=item_2)
msh2psrf_3 = MeshToPolysurface(Mesh=clean_2, Triangles=False, FaceMerge=False)

# ---- group: Preview of the reconstructed object
movement_just_for_visualization = Panel("{-100,100,100}")
merge = Merge(Data1=msh2psrf_3, Data2=item)
join = BrepJoin(Breps=merge)  # -> Breps, Closed
move = Move(Geometry=join.Breps, Motion=movement_just_for_visualization)  # -> Geometry, Transform

# ----
# Print parameters
path_resolution = Slider(1, range=0..100)
spiral_or_seam = Slider(1, range=0..1)
layer_height = Slider(5, range=0..30)
layer_width = Slider(3.5, range=0..200)

# ----
# Mesh to be printed
mesh_3 = Mesh()

speed = Slider(4500, range=0..10000)

# ----
# Obejct number /
# new export
export_data = Button()

# ---- group: Generate voxelized point cloud
voxellize = VoxellizePointCloud(
    CellSize=Slider(1.5, range=0..100),
    DecayRate=1,
    MaximumValue=Slider(100, range=0..1000),
    LowerThreshold=Slider(35, range=0..50))  # -> PointCloud, BoundingBox, VoxelData
deconstruct = DeconstructPointCloud(PointCloud=voxellize.PointCloud)  # -> Points, Colours, Normals

# ----
# Export Geometry
boolean_toggle = BooleanToggle(False)
directory = GhPythonScript(Number="1")  # -> FilePath
# ---------- directory: Python ----------
from ghpythonlib.componentbase import executingcomponent as component
import Grasshopper, GhPython
import System
import Rhino
import rhinoscriptsyntax as rs

class MyComponent(component):
    
    def RunScript(self, Number):
        """Provides a scripting component.
            Inputs:
                x: The x script variable
                y: The y script variable
            Output:
                a: The a output variable"""
        
        __author__ = "lachmayer"
        __version__ = "2022.05.24"
        
        import rhinoscriptsyntax as rs
        import os
        cwd = ghenv.Component.OnPingDocument().FilePath
        laenge = len(cwd)-12
        cwd1 = ""
        for i in range(laenge):
            cwd1 = (cwd1+cwd[i])
        cwd = cwd1
        cwd = cwd + "\mesh" + Number + ".stl"
        print(cwd)
        FilePath = cwd
                
        
        # return outputs if you have them; here I try it for you:
        return FilePath
# ---------- end directory ----------
pcexportstl = ExportSTL(
    Mesh=mesh_3,
    Relocate=boolean_toggle,
    SavePath=directory,
    SaveAsBinaryFile=True,
    SaveNow=export_data,
    LastSaveLocalization="neutral,N")

# ----
# Export Print parameters
directory_2 = GhPythonScript(Number="1")  # -> FilePath
# ---------- directory_2: Python ----------
from ghpythonlib.componentbase import executingcomponent as component
import Grasshopper, GhPython
import System
import Rhino
import rhinoscriptsyntax as rs

class MyComponent(component):
    
    def RunScript(self, Number):
        """Provides a scripting component.
            Inputs:
                x: The x script variable
                y: The y script variable
            Output:
                a: The a output variable"""
                
        __author__ = "lachmayer"
        __version__ = "2022.05.24"
                
        import rhinoscriptsyntax as rs
        import os
        cwd = ghenv.Component.OnPingDocument().FilePath
        laenge = len(cwd)-12
        cwd1 = ""
        for i in range(laenge):
            cwd1 = (cwd1+cwd[i])
        cwd = cwd1
        cwd = cwd + "\parameters" + Number + ".txt"
        print(cwd)
        FilePath = cwd
                
        
        # return outputs if you have them; here I try it for you:
        return FilePath
# ---------- end directory_2 ----------
merge_2 = Merge(Data1=layer_height, Data2=layer_width, Data3=path_resolution, Data4=spiral_or_seam)
join_2 = TextJoin(Text=merge_2, Join=";")
pcexporttxt = ExportTXT(
    Content=join_2,
    FileLocation=directory_2,
    Overwrite=export_data,
    Encoding="utf-8",
    Export=export_data,
    LastSaveLocalization="neutral,N")

cloud = ConstructCloud(Points=deconstruct.Points)
clo = Cloud(cloud)
